# Grasshopper definition DH_DocumentAndLayoutText_Example.gh (Grasshopper 1.0.7)
# plug-ins: DraftHorse

# ----
# Access/Edit Layout Text
# for layout specific data
pick_named_layout = Layouts({"Template"}, selected="Template")
getloindex = GetLayoutIndex(Name=pick_named_layout)  # -> LayoutIndex, Count
getlousertext = GetLayoutUserText(Index=getloindex.LayoutIndex)  # -> Keys, Values
panel = Panel("""1:1
3/4 Baltic Birch
10
Kitchen Casework
1""")
panel_2 = Panel(getlousertext.Keys)
panel_3 = Panel(getlousertext.Values)
getlovalue = AccessLayoutUserText(Index=getloindex.LayoutIndex)
setloutext = SetLayoutUserText(Index=getloindex.LayoutIndex, Keys=panel_2, Values=panel)  # -> Keys, Values

# ----
# Access/Edit Document Text
# for consistent project data
# note: document text keys starting
# with '.' are hidden from the user
panel_4 = Panel("GrasshopperFilePath")
ghdoc_path = CSharpScript()  # -> dir
# ---------- ghdoc_path: C# usings ----------
using System.IO;
# ---------- ghdoc_path: C# ----------
    string filePath = GrasshopperDocument.FilePath;
    dir = filePath;
# ---------- end ghdoc_path ----------
setdoctext = SetDocumentText(Keys=panel_4, Values=ghdoc_path)  # -> Keys, Values
accessdoctext = AccessDocumentText(Key=panel_4)
# See Layout Template for use of Text Fields with Document and Layout Text
getdoctext = GetDocumentText()  # -> Keys, Values
panel_5 = Panel(getdoctext.Keys)
panel_6 = Panel(setdoctext.Keys)
panel_7 = Panel(getdoctext.Values)
panel_8 = Panel(setdoctext.Values)

# ----
# Or Edit Named Text Objects on a Layout
pick_named_layout_2 = Layouts({"Template"}, selected="Template")
getloindex_2 = GetLayoutIndex(Name=pick_named_layout_2)  # -> LayoutIndex, Count
lotext = ModifyText(Run=False, Index=getloindex_2.LayoutIndex, Name="PageTitle", Text="Hello World!")
