# Grasshopper definition DH_ReferenceLayouts_Example.gh (Grasshopper 1.0.7)
# plug-ins: DraftHorse

newlayout = CreateNewLayout(Name="Template", Height=11, Width=17, Details=4, Scale=1, Units=0)  # -> LayoutIndex, LayoutName
new_layout_names = Panel("""Part1
Part2
Part3
Part4
Copy
Copy
Copy""")
copylayout = CopyLayout(TemplateIndex=newlayout.LayoutIndex, NewName=new_layout_names)  # -> LayoutIndex, LayoutName
getlonames = GetLayoutNames(Index=copylayout.LayoutIndex)
getloindex = GetLayoutIndex(Name=getlonames)  # -> LayoutIndex, Count
deletelayout = DeleteLayout(LayoutIndex=getloindex.LayoutIndex, Override=True)
getlonames_2 = GetLayoutNames(Index=getloindex.LayoutIndex)
panel = Panel(getlonames_2)
